# Grasshopper definition 20181009_tim_ModelImport.gh (Grasshopper 1.0.4)

python = GhPythonScript()  # -> out, a
# ---------- python: Python ----------
__author__ = "htwt"
__version__ = "2018.10.10"

import rhinoscriptsyntax as rs
import os
RootPath = "C:\Users\htwt\Desktop\model-demo"
FilePath = os.path.join(RootPath, "01.skp")
rs.Command("_ 0,0,0 2,2,2")
rs.Command("_-import " + FilePath + " _Enter")
#rs.Command("_Insert name")
# ---------- end python ----------
