# Grasshopper definition picArrange.gh (Grasshopper 0.9.80)
# plug-ins: Python Interpreter

pt = Point()
python = PythonScript(flag=Toggle(False))  # -> out, a; inputs flag: Boolean
# ---------- python: Python ----------
# -*- coding: UTF-8 -*-
__author__ = "htwt"

import rhinoscriptsyntax as rs
import os
import shutil

# 提取该物件的图层名字(放在数组中)
def getObjectsLayerNames():
	id = rs.GetObject("Please select a object")
	if id: return rs.ObjectLayer(id)

# 图层名字转换成路径
def layerNamesToPath(layerNames):
	return

# 通过路径打开文件
def viewPic():
	os.system('open /Users/htwt/timspace/arch/town-design/CY/M-08/01/01.png /Users/htwt/timspace/arch/town-design/CY/M-08/01/02.png')
	return


if (flag):
	layerNames = getObjectsLayerNames()
	a = layerNames
	#finalPath = layerNamesToPath(layerNames)
	#viewPic(finalPath)
# ---------- end python ----------
panel = Panel(python.a)
